# Dynamo graph Model to CSV Data.dyn (Dynamo 2.10.1.3976)
# packages: Genius Loci 2022.4.19, Autodesk Analytical Modeling 2022 Dynamo 1.0.1, Rhythm 2022.4.3

# group: Slab's Geometry
categories = Categories("OST_Floors")
all_elements_of_category = ElementsOfCategory(Category=categories)
getAnalyticalElement = Dynamo4AM.Utilities.FilterElements.GetAnalyticalElement(obj=all_elements_of_category)
boolean = BoolSelector(true)
getSurfaceFromAnalyticalElement = Dynamo4AM.Utilities.FilterElements.GetSurfaceFromAnalyticalElement(obj=getAnalyticalElement, includeBoundaries=boolean)
get_slabs_surfaces = List.FirstItem(list=getSurfaceFromAnalyticalElement, lacing=Shortest)
boolean_2 = BoolSelector(true)
surface_inner_centroid = Custom[Surface Inner Centroid](surface=get_slabs_surfaces, with_distance=boolean_2)  # package Genius Loci; Finds pole of inaccessibility for a given polygon. Calculates the visual center of a polygon (inside the polygon). Based on Vladimir Agafonkin's algorithm Polylabel. Please note that the node doesn't work with ellipsoidal or circular surfaces.
slabs_centroids = Watch(surface_inner_centroid.Centroid)
getJoinedElements = Element.GetJoinedElements(element=all_elements_of_category)
byCenterPointRadius = Circle.ByCenterPointRadius(centerPoint=surface_inner_centroid.Centroid, radius=surface_inner_centroid.Distance)

# group: Distances Between Slabs and Connected Columns
categories_2 = Categories("OST_StructuralColumns")
string = StringInput("Contains")
ʳʰʸᵗʰᵐ_elementfilter_bycategory = Rhythm.Revit.ElementFilter.ElementFilter.ByCategory(elements=getJoinedElements, category=categories_2, filterMethod=string)
getAnalyticalElement_2 = Dynamo4AM.Utilities.FilterElements.GetAnalyticalElement(obj=ʳʰʸᵗʰᵐ_elementfilter_bycategory)
getPointsFromAnalyticalElement = Dynamo4AM.Utilities.FilterElements.GetPointsFromAnalyticalElement(obj=getAnalyticalElement_2)
string_from_object = FromObject(object=getPointsFromAnalyticalElement)
getting_only_the_upper_points = CodeBlock(strList=string_from_object, points=getPointsFromAnalyticalElement)
# ---------- getting_only_the_upper_points.designscript (4 lines) ----------
strMask = "Z = 0.000";
mask = String.Contains(strList, strMask, false);
dictMask = List.FilterByBoolMask(points, mask);
filtered = Dictionary.ValueAtKey(dictMask, "out");
# ----------------------------------------
distanceTo = Geometry.DistanceTo(geometry=slabs_centroids, other=getting_only_the_upper_points.filtered)

# group: Distances Between Slabs and Connected Walls
categories_3 = Categories("OST_Walls")
string_2 = StringInput("Contains")
ʳʰʸᵗʰᵐ_elementfilter_bycategory_2 = Rhythm.Revit.ElementFilter.ElementFilter.ByCategory(elements=getJoinedElements, category=categories_3, filterMethod=string_2)
getAnalyticalElement_3 = Dynamo4AM.Utilities.FilterElements.GetAnalyticalElement(obj=ʳʰʸᵗʰᵐ_elementfilter_bycategory_2)
getSurfaceFromAnalyticalElement_2 = Dynamo4AM.Utilities.FilterElements.GetSurfaceFromAnalyticalElement(obj=getAnalyticalElement_3)
firstItem = List.FirstItem(list=getSurfaceFromAnalyticalElement_2@@L2)
distanceTo_2 = Geometry.DistanceTo(geometry=slabs_centroids, other=firstItem)

# group: Distances Between Slabs and Connected Beams
categories_4 = Categories("OST_StructuralFraming")
string_3 = StringInput("Contains")
ʳʰʸᵗʰᵐ_elementfilter_bycategory_3 = Rhythm.Revit.ElementFilter.ElementFilter.ByCategory(elements=getJoinedElements, category=categories_4, filterMethod=string_3)
getAnalyticalElement_4 = Dynamo4AM.Utilities.FilterElements.GetAnalyticalElement(obj=ʳʰʸᵗʰᵐ_elementfilter_bycategory_3)
getCurveFromAnalyticalElement = Dynamo4AM.Utilities.FilterElements.GetCurveFromAnalyticalElement(obj=getAnalyticalElement_4)
distanceTo_3 = Geometry.DistanceTo(geometry=slabs_centroids, other=getCurveFromAnalyticalElement)

# group: Calculating Minimum Distances of Walls and Columns
list_create = List.Create()  # unwired: item0, item1, item2
combine = List.Combine(combineFunction=list_create, list0=distanceTo, list1=distanceTo_2, list2=distanceTo_3)
flatten = List.Flatten()  # unwired: list
map = List.Map(list=combine, function=flatten)

# group: Slabs' Features
diameter_to_closest_element = CodeBlock(distances=map)
# ---------- diameter_to_closest_element.designscript (4 lines) ----------
featureName = "Closest Element Diameter";
minDistances = List.MinimumItem(distances);
doubleDistances = minDistances * 2;
nameFeatureList = List.AddItemToFront(featureName<1L>, doubleDistances<1L>);
# ----------------------------------------
calculate_inner_circles_diameter = CodeBlock(circle1=byCenterPointRadius)
# ---------- calculate_inner_circles_diameter.designscript (4 lines) ----------
featureName = "Inner Circle Diameter";
radius = Circle.Radius(circle1);
diameter = radius * 2;
nameFeatureList = List.AddItemToFront(featureName<1L>, diameter<1L>);
# ----------------------------------------
get_slabs_mark = CodeBlock(elemList=all_elements_of_category)
# ---------- get_slabs_mark.designscript (4 lines) ----------
featureName = "Slab ID";
parameterName = "Mark";
featureList = Elements.Element.GetParameterValueByName(elemList, parameterName);
nameFeatureList = List.AddItemToFront(featureName<1L>, featureList<1L>);
# ----------------------------------------
test_if_elements_exist_inside = CodeBlock(distances=diameter_to_closest_element.minDistances, radiuses=calculate_inner_circles_diameter.radius, marks=get_slabs_mark.featureList)  # "Test If Elements Exist Inside Biggest Inscribed Circle"
# ---------- test_if_elements_exist_inside.designscript (6 lines) ----------
delta = 0.001;
 // Delta for eliminating rounding errors;
deltaDistances = distances + delta;
boolDistances = radiuses > deltaDistances;
boolMarksDist = [marks, boolDistances];
innerElementsTest = List.Transpose(boolMarksDist);
# ----------------------------------------
is_there_an_element_inside_the = Watch(test_if_elements_exist_inside.innerElementsTest)  # "Is There an Element Inside the Slab?"; graph output
get_slabs_thickness = CodeBlock(elemList=all_elements_of_category)
# ---------- get_slabs_thickness.designscript (4 lines) ----------
featureName = "Slab Thickness";
parameterName = "Thickness";
featureList = Elements.Element.GetParameterValueByName(elemList, parameterName);
nameFeatureList = List.AddItemToFront(featureName<1L>, featureList<1L>);
# ----------------------------------------
get_slabs_volume = CodeBlock(elemList=all_elements_of_category)
# ---------- get_slabs_volume.designscript (4 lines) ----------
featureName = "Slab Volume";
parameterName = "Volume";
featureList = Elements.Element.GetParameterValueByName(elemList, parameterName);
nameFeatureList = List.AddItemToFront(featureName<1L>, featureList<1L>);
# ----------------------------------------
get_slabs_perimeter = CodeBlock(elemList=all_elements_of_category)
# ---------- get_slabs_perimeter.designscript (4 lines) ----------
featureName = "Slab Perimeter";
parameterName = "Perimeter";
featureList = Elements.Element.GetParameterValueByName(elemList, parameterName);
nameFeatureList = List.AddItemToFront(featureName<1L>, featureList<1L>);
# ----------------------------------------
get_slabs_connections = CodeBlock(elemList=getJoinedElements)
# ---------- get_slabs_connections.designscript (4 lines) ----------
featureName = "Slab Connections";
parameterName = "Mark";
featureList = Elements.Element.GetParameterValueByName(elemList, parameterName);
nameFeatureList = List.AddItemToFront(featureName<1L>, featureList<1L>);
# ----------------------------------------

# group: Script Input
gross_height = DoubleSlider(3.07, range=2.5..10 step 0.01)  # graph input
path_for_saving_csv_files = Directory("C:\Users\alonf\OneDrive - Technion\Research Data\AIPDORCS\Dynamo")  # graph input
structure_type_1_residential_2 = IntegerSlider(1, range=1..3 step 1)  # "Structure Type: 1-Residential, 2-Commercial, 3-Indutrial"; graph input
number_of_floors = IntegerSlider(15, range=0..50 step 1)  # graph input

# group: Updating Level Elevation According to Gross Height
categories_5 = Categories("OST_Levels")
all_elements_of_category_2 = ElementsOfCategory(Category=categories_5)
string_from_object_2 = FromObject(object=all_elements_of_category_2)
getting_only_the_upper_points_2 = CodeBlock(strList=string_from_object_2, elemList=all_elements_of_category_2)
# ---------- getting_only_the_upper_points_2.designscript (4 lines) ----------
strMask = "Typical Floor";
mask = String.Contains(strList, strMask, false);
dict = List.FilterByBoolMask(elemList, mask);
filteredLevel = Dictionary.ValueAtKey(dict, "in");
# ----------------------------------------
string_4 = StringInput("Elevation")
converting_m_to_cm = CodeBlock(elevation_m=gross_height) { elevation_cm = elevation_m * 100; }
setParameterByName = Element.SetParameterByName(element=getting_only_the_upper_points_2.filteredLevel, parameterName=string_4, value=converting_m_to_cm)

# group: Getting Project Name & Creating a Folder For It
categories_6 = Categories("OST_ProjectInformation")
all_elements_of_category_3 = ElementsOfCategory(Category=categories_6)
string_5 = StringInput("Project Name")
get_project_name = Element.GetParameterValueByName(element=all_elements_of_category_3, parameterName=string_5)
string_from_object_3 = FromObject(object=get_project_name)
creating_project_folder = CodeBlock(projectIDList=string_from_object_3, inputPath=path_for_saving_csv_files) { slash = "\\"; projectID = List.FirstItem(projectIDList); strPath = String.Concat([inputPath, slash, projectID]); }
directory_from_path = DirectoryObject(path=creating_project_folder.strPath)
string_from_object_4 = FromObject(object=directory_from_path)

# group: ProjectData.csv
string_6 = StringInput("\ProjectData.csv")
concat = String.Concat(string0=string_from_object_4, string1=string_6)
get_project_s_name = CodeBlock(value=creating_project_folder.projectID) { featureName = "Project ID"; nameFeatureList = List.AddItemToFront(featureName<1L>, value<1L>); }
get_project_s_structure_type = CodeBlock(value=structure_type_1_residential_2)
# ---------- get_project_s_structure_type.designscript (3 lines) ----------
featureName = "Structure Type";
feature = value == 1 ? "Residential" : value == 2 ? "Commercial" : "Industrial";
nameFeatureList = List.AddItemToFront(featureName<1L>, feature<1L>);
# ----------------------------------------
get_project_s_number_of_floors = CodeBlock(value=number_of_floors) { featureName = "Number of Floors"; nameFeatureList = List.AddItemToFront(featureName<1L>, value<1L>); }
get_project_s_gross_height = CodeBlock(value=gross_height) { featureName = "Gross Height"; nameFeatureList = List.AddItemToFront(featureName<1L>, value<1L>); }
list_create_2 = List.Create(item0=get_project_s_name.nameFeatureList, item1=get_project_s_structure_type.nameFeatureList, item2=get_project_s_number_of_floors.nameFeatureList, item3=get_project_s_gross_height.nameFeatureList)
exportCSV = Data.ExportCSV(filePath=concat, data=list_create_2)

# group: Columns' Features
categories_7 = Categories("OST_StructuralColumns")
all_elements_of_category_4 = ElementsOfCategory(Category=categories_7)
filter_out_sofistik = CodeBlock(columnList=all_elements_of_category_4)  # "Filter Out "SOFiSTIK_ReferencePoint""
# ---------- filter_out_sofistik.designscript (4 lines) ----------
families = Family.Name(columnList);
familyToFilter = "SOFiSTiK_ReferencePoint";
indices = List.AllIndicesOf(families, familyToFilter);
filteredList = List.RemoveItemAtIndex(columnList, indices);
# ----------------------------------------
get_columns_mark = CodeBlock(elemList=filter_out_sofistik.filteredList)
# ---------- get_columns_mark.designscript (4 lines) ----------
featureName = "Column ID";
parameterName = "Mark";
featureList = Elements.Element.GetParameterValueByName(elemList, parameterName);
nameFeatureList = List.AddItemToFront(featureName<1L>, featureList<1L>);
# ----------------------------------------
get_columns_length = CodeBlock(elemList=filter_out_sofistik.filteredList)
# ---------- get_columns_length.designscript (4 lines) ----------
featureName = "Column Length";
parameterName = "Length";
featureList = Elements.Element.GetParameterValueByName(elemList, parameterName);
nameFeatureList = List.AddItemToFront(featureName<1L>, featureList<1L>);
# ----------------------------------------
name = Element.Name(element=filter_out_sofistik.filteredList)
get_columns_volume = CodeBlock(elemList=filter_out_sofistik.filteredList)
# ---------- get_columns_volume.designscript (4 lines) ----------
featureName = "Column Volume";
parameterName = "Volume";
featureList = Elements.Element.GetParameterValueByName(elemList, parameterName);
nameFeatureList = List.AddItemToFront(featureName<1L>, featureList<1L>);
# ----------------------------------------
getJoinedElements_2 = Element.GetJoinedElements(element=filter_out_sofistik.filteredList)
get_columns_connections = CodeBlock(elemList=getJoinedElements_2)
# ---------- get_columns_connections.designscript (4 lines) ----------
featureName = "Column Connections";
parameterName = "Mark";
featureList = Elements.Element.GetParameterValueByName(elemList, parameterName);
nameFeatureList = List.AddItemToFront(featureName<1L>, featureList<1L>);
# ----------------------------------------

# group: Getting Columns' Cross Section Dimensions
creating_a_plane_in_half_height = CodeBlock(lengths=get_columns_length.featureList)  # "Creating a Plane in Half Height of the Columns"
# ---------- creating_a_plane_in_half_height.designscript (4 lines) ----------
minLength = List.MinimumItem(lengths);
halfLength = minLength / 2;
point1 = Point.ByCoordinates(0, 0, halfLength);
planeHalfHeight = Plane.ByOriginNormal(point1, Autodesk.Vector.ByCoordinates(0, 0, 1));
# ----------------------------------------
solids = Element.Solids(element=filter_out_sofistik.filteredList)
columns_cross_section_surfaces = Geometry.IntersectAll(geometry=creating_a_plane_in_half_height.planeHalfHeight, others=solids)
flatten_2 = List.Flatten(list=columns_cross_section_surfaces)
area = Surface.Area(surface=flatten_2)
spliting_columns_names_to = CodeBlock(elementNames=name) { separator = "/"; dimensionList = String.Split(elementNames, [separator]); h = List.MaximumItem(dimensionList); }  # "Spliting Columns' Names to Dimensions"
caclculating_equivalent_b_by = Python(IN[0]=area, IN[1]=spliting_columns_names_to.h)  # "Caclculating Equivalent b by area and h"; IronPython2
# ---------- caclculating_equivalent_b_by.python (6 lines) ----------
area = IN[0]
h = IN[1]
b = []
for i in range(len(area)):
    b.append(float(area[i]) / float(h[i]))
OUT = b
# ----------------------------------------
columns_equivalent_b_dimension = CodeBlock(values=caclculating_equivalent_b_by) { featureName = "Column b"; nameFeatureList = List.AddItemToFront(featureName<1L>, values<1L>); }
columns_h_dimension = CodeBlock(values=spliting_columns_names_to.h) { featureName = "Column h"; nameFeatureList = List.AddItemToFront(featureName<1L>, values<1L>); }

# group: ColumnsData.csv
string_7 = StringInput("\ColumnsData.csv")
concat_2 = String.Concat(string0=string_from_object_4, string1=string_7)
list_create_3 = List.Create(item0=get_columns_mark.nameFeatureList, item1=get_columns_length.nameFeatureList, item2=columns_equivalent_b_dimension.nameFeatureList, item3=columns_h_dimension.nameFeatureList, item4=get_columns_volume.nameFeatureList, item5=get_columns_connections.nameFeatureList)
transpose_flatten_once = CodeBlock(list=list_create_3) { transposedList = List.Transpose(list); flattenedList = List.Flatten(transposedList, 1); }
exportCSV_2 = Data.ExportCSV(filePath=concat_2, data=transpose_flatten_once.flattenedList)

# group: SlabsData.csv
string_8 = StringInput("\SlabsData.csv")
concat_3 = String.Concat(string0=string_from_object_4, string1=string_8)
list_create_4 = List.Create(item0=get_slabs_mark.nameFeatureList, item1=get_slabs_thickness.nameFeatureList, item2=calculate_inner_circles_diameter.nameFeatureList, item3=diameter_to_closest_element.nameFeatureList, item4=get_slabs_volume.nameFeatureList, item5=get_slabs_perimeter.nameFeatureList, item6=get_slabs_connections.nameFeatureList)
transpose_flatten_once_2 = CodeBlock(list=list_create_4) { transposedList = List.Transpose(list); flattenedList = List.Flatten(transposedList, 1); }
exportCSV_3 = Data.ExportCSV(filePath=concat_3, data=transpose_flatten_once_2.flattenedList)

# group: Walls' Features
categories_8 = Categories("OST_Walls")
all_elements_of_category_5 = ElementsOfCategory(Category=categories_8)
get_walls_mark = CodeBlock(elemList=all_elements_of_category_5)
# ---------- get_walls_mark.designscript (4 lines) ----------
featureName = "Wall ID";
parameterName = "Mark";
featureList = Elements.Element.GetParameterValueByName(elemList, parameterName);
nameFeatureList = List.AddItemToFront(featureName<1L>, featureList<1L>);
# ----------------------------------------
get_walls_height = CodeBlock(elemList=all_elements_of_category_5)
# ---------- get_walls_height.designscript (4 lines) ----------
featureName = "Wall Height";
parameterName = "Unconnected Height";
featureList = Elements.Element.GetParameterValueByName(elemList, parameterName);
nameFeatureList = List.AddItemToFront(featureName<1L>, featureList<1L>);
# ----------------------------------------
get_walls_width = CodeBlock(elemList=all_elements_of_category_5)
# ---------- get_walls_width.designscript (3 lines) ----------
featureName = "Wall Width";
featureList = Elements.Element.Name(elemList);
nameFeatureList = List.AddItemToFront(featureName<1L>, featureList<1L>);
# ----------------------------------------
get_walls_length = CodeBlock(elemList=all_elements_of_category_5)
# ---------- get_walls_length.designscript (4 lines) ----------
featureName = "Wall Length";
parameterName = "Length";
featureList = Elements.Element.GetParameterValueByName(elemList, parameterName);
nameFeatureList = List.AddItemToFront(featureName<1L>, featureList<1L>);
# ----------------------------------------
get_walls_volume = CodeBlock(elemList=all_elements_of_category_5)
# ---------- get_walls_volume.designscript (4 lines) ----------
featureName = "Wall Volume";
parameterName = "Volume";
featureList = Elements.Element.GetParameterValueByName(elemList, parameterName);
nameFeatureList = List.AddItemToFront(featureName<1L>, featureList<1L>);
# ----------------------------------------
get_joined_elements = Custom[Get Joined Elements](element=all_elements_of_category_5@L1)  # package Genius Loci; Returns all elements joined to the given element.
get_walls_connections = CodeBlock(elemList=get_joined_elements)
# ---------- get_walls_connections.designscript (4 lines) ----------
featureName = "Wall Connections";
parameterName = "Mark";
featureList = Elements.Element.GetParameterValueByName(elemList, parameterName);
nameFeatureList = List.AddItemToFront(featureName<1L>, featureList<1L>);
# ----------------------------------------

# group: WallsData.csv
string_9 = StringInput("\WallsData.csv")
concat_4 = String.Concat(string0=string_from_object_4, string1=string_9)
list_create_5 = List.Create(item0=get_walls_mark.nameFeatureList, item1=get_walls_height.nameFeatureList, item2=get_walls_width.nameFeatureList, item3=get_walls_length.nameFeatureList, item4=get_walls_volume.nameFeatureList, item5=get_walls_connections.nameFeatureList)
transpose_flatten_once_3 = CodeBlock(list=list_create_5) { transposedList = List.Transpose(list); flattenedList = List.Flatten(transposedList, 1); }
exportCSV_4 = Data.ExportCSV(filePath=concat_4, data=transpose_flatten_once_3.flattenedList)

# group: Beams' Features
categories_9 = Categories("OST_StructuralFraming")
all_elements_of_category_6 = ElementsOfCategory(Category=categories_9)
get_beams_mark = CodeBlock(elemList=all_elements_of_category_6)
# ---------- get_beams_mark.designscript (4 lines) ----------
featureName = "Beam ID";
parameterName = "Mark";
featureList = Elements.Element.GetParameterValueByName(elemList, parameterName);
nameFeatureList = List.AddItemToFront(featureName<1L>, featureList<1L>);
# ----------------------------------------
get_beams_length = CodeBlock(elemList=all_elements_of_category_6)
# ---------- get_beams_length.designscript (4 lines) ----------
featureName = "Beam Length";
parameterName = "Length";
featureList = Elements.Element.GetParameterValueByName(elemList, parameterName);
nameFeatureList = List.AddItemToFront(featureName<1L>, featureList<1L>);
# ----------------------------------------
getting_beams_cross_section = CodeBlock(elemList=all_elements_of_category_6)  # "Getting Beams' Cross Section Dimensions"
# ---------- getting_beams_cross_section.designscript (5 lines) ----------
elementNames = Elements.Element.Name(elemList);
separator = "/";
dimensionList = String.Split(elementNames, [separator]);
b = List.MinimumItem(dimensionList);
h = List.MaximumItem(dimensionList);
# ----------------------------------------
beams_b_dimension = CodeBlock(values=getting_beams_cross_section.b) { featureName = "Beam b"; nameFeatureList = List.AddItemToFront(featureName<1L>, values<1L>); }
beams_h_dimension = CodeBlock(values=getting_beams_cross_section.h) { featureName = "Beam h"; nameFeatureList = List.AddItemToFront(featureName<1L>, values<1L>); }
get_beams_volume = CodeBlock(elemList=all_elements_of_category_6)
# ---------- get_beams_volume.designscript (4 lines) ----------
featureName = "Beam Volume";
parameterName = "Volume";
featureList = Elements.Element.GetParameterValueByName(elemList, parameterName);
nameFeatureList = List.AddItemToFront(featureName<1L>, featureList<1L>);
# ----------------------------------------
get_joined_elements_2 = Custom[Get Joined Elements](element=all_elements_of_category_6@L1)
get_beams_connections = CodeBlock(elemList=get_joined_elements_2)
# ---------- get_beams_connections.designscript (4 lines) ----------
featureName = "Beam Connections";
parameterName = "Mark";
featureList = Elements.Element.GetParameterValueByName(elemList, parameterName);
nameFeatureList = List.AddItemToFront(featureName<1L>, featureList<1L>);
# ----------------------------------------

# group: BeamsData.csv
string_10 = StringInput("\BeamsData.csv")
concat_5 = String.Concat(string0=string_from_object_4, string1=string_10)
list_create_6 = List.Create(item0=get_beams_mark.nameFeatureList, item1=get_beams_length.nameFeatureList, item2=beams_b_dimension.nameFeatureList, item3=beams_h_dimension.nameFeatureList, item4=get_beams_volume.nameFeatureList, item5=get_beams_connections.nameFeatureList)
transpose_flatten_once_4 = CodeBlock(list=list_create_6) { transposedList = List.Transpose(list); flattenedList = List.Flatten(transposedList, 1); }
exportCSV_5 = Data.ExportCSV(filePath=concat_5, data=transpose_flatten_once_4.flattenedList)
