# Dynamo graph Model to Graph.dyn (Dynamo 2.12.0.5650)
# packages: Autodesk Analytical Modeling 2022 Dynamo 1.0.1, Genius Loci 2022.4.19, Rhythm 2022.4.3

# group: Columns' Features
categories = Categories("OST_StructuralColumns")
all_elements_of_category = ElementsOfCategory(Category=categories)
filter_out_sofistik = CodeBlock(columnList=all_elements_of_category)  # "Filter out "SOFiSTIK_ReferencePoint""
# ---------- filter_out_sofistik.designscript (4 lines) ----------
families = Family.Name(columnList);
familyToFilter = "SOFiSTiK_ReferencePoint";
indices = List.AllIndicesOf(families, familyToFilter);
filteredList = List.RemoveItemAtIndex(columnList, indices);
# ----------------------------------------
getJoinedElements = Element.GetJoinedElements(element=filter_out_sofistik.filteredList)
string = StringInput("Mark")
get_columns_connections = Element.GetParameterValueByName(element=getJoinedElements, parameterName=string)
name = Element.Name(element=filter_out_sofistik.filteredList)
string_2 = StringInput("Length")
get_columns_length = Element.GetParameterValueByName(element=filter_out_sofistik.filteredList, parameterName=string_2)
string_3 = StringInput("Mark")
get_columns_mark = Element.GetParameterValueByName(element=filter_out_sofistik.filteredList, parameterName=string_3)

# group: Beams' Features
categories_2 = Categories("OST_StructuralFraming")
all_elements_of_category_2 = ElementsOfCategory(Category=categories_2)
string_4 = StringInput("Length")
get_beams_length = Element.GetParameterValueByName(element=all_elements_of_category_2, parameterName=string_4)
name_2 = Element.Name(element=all_elements_of_category_2)
get_joined_elements = Custom[Get Joined Elements](element=all_elements_of_category_2@L1)  # package Genius Loci; Returns all elements joined to the given element.
string_5 = StringInput("Mark")
get_beams_connections = Element.GetParameterValueByName(element=get_joined_elements, parameterName=string_5)
string_6 = StringInput("Mark")
get_beams_mark = Element.GetParameterValueByName(element=all_elements_of_category_2, parameterName=string_6)

# group: Walls' Features
categories_3 = Categories("OST_Walls")
all_elements_of_category_3 = ElementsOfCategory(Category=categories_3)
get_joined_elements_2 = Custom[Get Joined Elements](element=all_elements_of_category_3@L1)
string_7 = StringInput("Mark")
get_walls_connections = Element.GetParameterValueByName(element=get_joined_elements_2, parameterName=string_7)
get_walls_width = Element.Name(element=all_elements_of_category_3)
string_8 = StringInput("Length")
get_walls_length = Element.GetParameterValueByName(element=all_elements_of_category_3, parameterName=string_8)
string_9 = StringInput("Unconnected Height")
get_walls_height = Element.GetParameterValueByName(element=all_elements_of_category_3, parameterName=string_9)
string_10 = StringInput("Mark")
get_walls_mark = Element.GetParameterValueByName(element=all_elements_of_category_3, parameterName=string_10)

# group: Script Input
directory_path = Directory("C:\Users\A.D.A\OneDrive - Technion\Research Data\VSCode\Dynamo")  # graph input
number_of_floors = IntegerSlider(0, range=0..50 step 1)
gross_height = DoubleSlider(3.66, range=2.5..10 step 0.01)

# group: Slab's Geometry
categories_4 = Categories("OST_Floors")
all_elements_of_category_4 = ElementsOfCategory(Category=categories_4)
getAnalyticalElement = Dynamo4AM.Utilities.FilterElements.GetAnalyticalElement(obj=all_elements_of_category_4)
boolean = BoolSelector(true)
getSurfaceFromAnalyticalElement = Dynamo4AM.Utilities.FilterElements.GetSurfaceFromAnalyticalElement(obj=getAnalyticalElement, includeBoundaries=boolean)
get_slabs_surfaces = List.FirstItem(list=getSurfaceFromAnalyticalElement, lacing=Shortest)
boolean_2 = BoolSelector(true)
surface_inner_centroid = Custom[Surface Inner Centroid](surface=get_slabs_surfaces, with_distance=boolean_2)  # package Genius Loci; Finds pole of inaccessibility for a given polygon. Calculates the visual center of a polygon (inside the polygon). Based on Vladimir Agafonkin's algorithm Polylabel. Please note that the node doesn't work with ellipsoidal or circular surfaces.
byCenterPointRadius = Circle.ByCenterPointRadius(centerPoint=surface_inner_centroid.Centroid, radius=surface_inner_centroid.Distance)
slabs_centroids = Watch(surface_inner_centroid.Centroid)
getJoinedElements_2 = Element.GetJoinedElements(element=all_elements_of_category_4)

# group: Distances Between Slabs and Connected Columns
categories_5 = Categories("OST_StructuralColumns")
string_11 = StringInput("Contains")
ʳʰʸᵗʰᵐ_elementfilter_bycategory = Rhythm.Revit.ElementFilter.ElementFilter.ByCategory(elements=getJoinedElements_2, category=categories_5, filterMethod=string_11)
getAnalyticalElement_2 = Dynamo4AM.Utilities.FilterElements.GetAnalyticalElement(obj=ʳʰʸᵗʰᵐ_elementfilter_bycategory)
getPointsFromAnalyticalElement = Dynamo4AM.Utilities.FilterElements.GetPointsFromAnalyticalElement(obj=getAnalyticalElement_2)
string_from_object = FromObject(object=getPointsFromAnalyticalElement)
getting_only_the_upper_points = CodeBlock(strList=string_from_object, points=getPointsFromAnalyticalElement)
# ---------- getting_only_the_upper_points.designscript (4 lines) ----------
strMask = "Z = 0.000";
mask = String.Contains(strList, strMask, false);
dictMask = List.FilterByBoolMask(points, mask);
filtered = Dictionary.ValueAtKey(dictMask, "out");
# ----------------------------------------
distanceTo = Geometry.DistanceTo(geometry=slabs_centroids, other=getting_only_the_upper_points.filtered)

# group: Distances Between Slabs and Connected Walls
categories_6 = Categories("OST_Walls")
string_12 = StringInput("Contains")
ʳʰʸᵗʰᵐ_elementfilter_bycategory_2 = Rhythm.Revit.ElementFilter.ElementFilter.ByCategory(elements=getJoinedElements_2, category=categories_6, filterMethod=string_12)
getAnalyticalElement_3 = Dynamo4AM.Utilities.FilterElements.GetAnalyticalElement(obj=ʳʰʸᵗʰᵐ_elementfilter_bycategory_2)
getSurfaceFromAnalyticalElement_2 = Dynamo4AM.Utilities.FilterElements.GetSurfaceFromAnalyticalElement(obj=getAnalyticalElement_3)
firstItem = List.FirstItem(list=getSurfaceFromAnalyticalElement_2@@L2)
distanceTo_2 = Geometry.DistanceTo(geometry=slabs_centroids, other=firstItem)

# group: Calculating Minimum Distances of Walls and Columns
list_create = List.Create()  # unwired: item0, item1
combine = List.Combine(combineFunction=list_create, list0=distanceTo, list1=distanceTo_2)
flatten = List.Flatten()  # unwired: list
map = List.Map(list=combine, function=flatten)

# group: Slabs' Features
string_13 = StringInput("Mark")
get_slabs_mark = Element.GetParameterValueByName(element=all_elements_of_category_4, parameterName=string_13)
string_14 = StringInput("Thickness")
get_slabs_thickness = Element.GetParameterValueByName(element=all_elements_of_category_4, parameterName=string_14)
calculate_inner_circles_diameter = CodeBlock(circle1=byCenterPointRadius) { R = Circle.Radius(circle1); Diameter = R * 2; }
code_block = CodeBlock(distances=map) { minDistances = List.MinimumItem(distances); doubleDistances = minDistances * 2; }
string_15 = StringInput("Mark")
get_slabs_connections = Element.GetParameterValueByName(element=getJoinedElements_2, parameterName=string_15)
test_if_elements_exist_inside = CodeBlock(distances=code_block.minDistances, radiuses=calculate_inner_circles_diameter.R, marks=get_slabs_mark)  # "Test If Elements Exist Inside Biggest Inscribed Circle"
# ---------- test_if_elements_exist_inside.designscript (6 lines) ----------
delta = 0.001;
 // Delta for eliminating rounding errors;
deltaDistances = distances + delta;
boolDistances = radiuses > deltaDistances;
boolMarksDist = [marks, boolDistances];
innerElementsTest = List.Transpose(boolMarksDist);
# ----------------------------------------
is_there_an_element_inside_the = Watch(test_if_elements_exist_inside.innerElementsTest)  # "Is There an Element Inside the Slab?"; graph output

# group: Nodes.csv
string_16 = StringInput("\Nodes.csv")
concat = String.Concat(string0=directory_path, string1=string_16)
list_create_2 = List.Create(item0=get_slabs_mark, item1=get_columns_mark, item2=get_beams_mark, item3=get_walls_mark)
flatten_2 = List.Flatten(list=list_create_2)
exportCSV = Data.ExportCSV(filePath=concat, data=flatten_2)

# group: SlabsData.csv
string_17 = StringInput("\SlabsData.csv")
concat_2 = String.Concat(string0=directory_path, string1=string_17)
list_create_3 = List.Create(item0=get_slabs_mark, item1=get_slabs_thickness, item2=calculate_inner_circles_diameter.Diameter, item3=code_block.doubleDistances, item4=get_slabs_connections)
transpose = List.Transpose(lists=list_create_3)
flatten_list_once = CodeBlock(list=transpose) { flattenedList = List.Flatten(list, 1); }
exportCSV_2 = Data.ExportCSV(filePath=concat_2, data=flatten_list_once)

setParameterByName = Element.SetParameterByName()  # unwired: element, parameterName, value
categories_7 = Categories("OST_Levels")
all_elements_of_category_5 = ElementsOfCategory(Category=categories_7)
getting_only_the_upper_points_2 = CodeBlock(strList=all_elements_of_category_5) { strMask = "Typical Floor"; mask = String.Contains(strList, strMask, false); }
